# Grasshopper definition LatticeTools-Demo.gh (Grasshopper 1.0.7)
# plug-ins: jSwan, LatticeTools, Weaverbird, DendroGH

# ----
# Enter your notes here
panel = Panel()

geometry = Geometry([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])

# ----
# Parameters
cell_length = X(3)
cell_length_2 = X(cell_length)
number_slider = Slider(0.15, range=0.05..0.5)
number = Number(number_slider)

cell_length_3 = X(cell_length)
geometry_2 = Geometry([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])
number_2 = Number(number_slider)

# ----
# Requires complete path.
# The folder must exist.
panel_2 = Panel("")

# ----
# Logging
# Enter the name of
# the project folder
# for this file
panel_3 = Panel("LatticeTools")

multiplication = Multiplication(A=cell_length_3, B=number_2)
weaverbird_s_join_meshes_and_weld = WeaverbirdsJoinMeshesAndWeld(Mesh=geometry, Weld=True)
weaverbird_s_join_meshes_and_weld_2 = WeaverbirdsJoinMeshesAndWeld(Mesh=geometry_2, Weld=True)
cylinder = Cylinder(Base=PlaneXY(0, 0, 0), Radius=5.5, Length=18)
r = Number(multiplication)
closed_geometry = Geometry(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)
closed_geometry_2 = Geometry(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)
open_geometry = Geometry(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)
open_geometry_2 = Geometry(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)
box = Box([{Plane=PlaneXY(-7.5, -7.5, 0), X=Domain(-1.5, 1.5), Y=Domain(-1.5, 1.5), Z=Domain(-1.5, 1.5)}, {Plane=PlaneXY(-4.5, -7.5, 0), X=Domain(-1.5, 1.5), Y=Domain(-1.5, 1.5), Z=Domain(-1.5, 1.5)}, {Plane=PlaneXY(-1.5, -7.5, 0), X=Domain(-1.5, 1.5), Y=Domain(-1.5, 1.5), Z=Domain(-1.5, 1.5)}, {Plane=PlaneXY(1.5, -7.5, 0), X=Domain(-1.5, 1.5), Y=Domain(-1.5, 1.5), Z=Domain(-1.5, 1.5)}, {Plane=PlaneXY(4.5, -7.5, 0), X=Domain(-1.5, 1.5), Y=Domain(-1.5, 1.5), Z=Domain(-1.5, 1.5)}, {Plane=PlaneXY(7.5, -7.5, 0), X=Domain(-1.5, 1.5), Y=Domain(-1.5, 1.5), Z=Domain(-1.5, 1.5)}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])
box_2 = Box([{Plane=PlaneXY(-7.5, -7.5, 0), X=Domain(-1.5, 1.5), Y=Domain(-1.5, 1.5), Z=Domain(-1.5, 1.5)}, {Plane=PlaneXY(-4.5, -7.5, 0), X=Domain(-1.5, 1.5), Y=Domain(-1.5, 1.5), Z=Domain(-1.5, 1.5)}, {Plane=PlaneXY(-1.5, -7.5, 0), X=Domain(-1.5, 1.5), Y=Domain(-1.5, 1.5), Z=Domain(-1.5, 1.5)}, {Plane=PlaneXY(1.5, -7.5, 0), X=Domain(-1.5, 1.5), Y=Domain(-1.5, 1.5), Z=Domain(-1.5, 1.5)}, {Plane=PlaneXY(4.5, -7.5, 0), X=Domain(-1.5, 1.5), Y=Domain(-1.5, 1.5), Z=Domain(-1.5, 1.5)}, {Plane=PlaneXY(7.5, -7.5, 0), X=Domain(-1.5, 1.5), Y=Domain(-1.5, 1.5), Z=Domain(-1.5, 1.5)}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])
curve = Curve([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])
box_3 = Box([{Plane=PlaneXY(-7.5, -7.5, 0), X=Domain(-1.5, 1.5), Y=Domain(-1.5, 1.5), Z=Domain(-1.5, 1.5)}, {Plane=PlaneXY(-4.5, -7.5, 0), X=Domain(-1.5, 1.5), Y=Domain(-1.5, 1.5), Z=Domain(-1.5, 1.5)}, {Plane=PlaneXY(-1.5, -7.5, 0), X=Domain(-1.5, 1.5), Y=Domain(-1.5, 1.5), Z=Domain(-1.5, 1.5)}, {Plane=PlaneXY(1.5, -7.5, 0), X=Domain(-1.5, 1.5), Y=Domain(-1.5, 1.5), Z=Domain(-1.5, 1.5)}, {Plane=PlaneXY(4.5, -7.5, 0), X=Domain(-1.5, 1.5), Y=Domain(-1.5, 1.5), Z=Domain(-1.5, 1.5)}, {Plane=PlaneXY(7.5, -7.5, 0), X=Domain(-1.5, 1.5), Y=Domain(-1.5, 1.5), Z=Domain(-1.5, 1.5)}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])
curve_2 = Curve([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])
box_4 = Box([{Plane=PlaneXY(-7.5, -7.5, 0), X=Domain(-1.5, 1.5), Y=Domain(-1.5, 1.5), Z=Domain(-1.5, 1.5)}, {Plane=PlaneXY(-4.5, -7.5, 0), X=Domain(-1.5, 1.5), Y=Domain(-1.5, 1.5), Z=Domain(-1.5, 1.5)}, {Plane=PlaneXY(-1.5, -7.5, 0), X=Domain(-1.5, 1.5), Y=Domain(-1.5, 1.5), Z=Domain(-1.5, 1.5)}, {Plane=PlaneXY(1.5, -7.5, 0), X=Domain(-1.5, 1.5), Y=Domain(-1.5, 1.5), Z=Domain(-1.5, 1.5)}, {Plane=PlaneXY(4.5, -7.5, 0), X=Domain(-1.5, 1.5), Y=Domain(-1.5, 1.5), Z=Domain(-1.5, 1.5)}, {Plane=PlaneXY(7.5, -7.5, 0), X=Domain(-1.5, 1.5), Y=Domain(-1.5, 1.5), Z=Domain(-1.5, 1.5)}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])
delete = BooleanToggle(False)
run = BooleanToggle(False)
bake = BooleanToggle(False)
save = BooleanToggle(False)
# Individual Component Examples
cap_holes = CapHoles(Brep=cylinder)
r_2 = Number(r)
cell_length_4 = X(cell_length)
r_3 = Number(r)
number_3 = Number(number_slider)
surfaces = Surfaces([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])
point = Point([Point(5.5, 0, 0), Point(5.499263656, 0.08999575749, 0), Point(5.497054819, 0.1799675465, 0), Point(5.493374075, 0.2698912133, 0), Point(5.488222411, 0.3597426395, 0), Point(5.481601211, 0.4494976851, 0)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])
r_4 = Number(r)
curve_3 = Curve(Tree({0;0}: [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], {0;0;0}: [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]))
r_5 = Number(r)
populate_lattice_uniform = PopulateLatticeUniform(
    Core_voxels=box_3,
    Boundary_voxels=box,
    Unit_cell=curve_2,
    Connectivity=weaverbird_s_join_meshes_and_weld,
    Primitive=closed_geometry)  # -> Lattice_core, Lattice_boundary, Lattice_trimmed, Lattice_boundary_connect, Lattice_skin
populate_lattice_uniform_2 = PopulateLatticeUniform(
    Core_voxels=box_4,
    Boundary_voxels=box_2,
    Unit_cell=curve,
    Connectivity=weaverbird_s_join_meshes_and_weld_2,
    Primitive=open_geometry_2)  # -> Lattice_core, Lattice_boundary, Lattice_trimmed, Lattice_boundary_connect, Lattice_skin
serialize_json = SerializeJson(
    Voxelization="Basic",
    Unit_cell="Cubic",
    Cell_length=cell_length_4,
    Strut_radius=r_3,
    Dimensionless_radius=number_3,
    IncludeNullAndEmptyProperties=False)

# ----
# Connectivity
cell_length_5 = X(cell_length)
division = Division(A=cell_length_5, B=2)
center_box = CenterBox(Base=PlaneXY(0, 0, 0), X=division, Y=division, Z=division)

primitive_prepare_origin = PrimitivePrepareOrigin(Primitive=cap_holes)  # -> Primitive, Cut_surfaces, Symmetry_surfaces, Octant, Quarter
segment_lattice = SegmentLattice(Curves=flatten(curve_3), Radius=r_5)

# ----
# Controls
delete_2 = BooleanToggle(False)
bake_2 = BooleanToggle(False)
save_2 = BooleanToggle(False)
run_2 = BooleanToggle(False)

# ----
# Unit Cell
brep_wireframe = BrepWireframe(Brep=center_box, Density=-1)

geometry_3 = Geometry(primitive_prepare_origin.Symmetry_surfaces)
geometry_4 = Geometry(primitive_prepare_origin.Primitive)
geometry_5 = Geometry(primitive_prepare_origin.Cut_surfaces)
geometry_6 = Geometry(primitive_prepare_origin.Octant)
geometry_7 = Geometry(populate_lattice_uniform.Lattice_core)
geometry_8 = Geometry(populate_lattice_uniform.Lattice_trimmed)
geometry_9 = Geometry(populate_lattice_uniform.Lattice_skin)
geometry_10 = Geometry(populate_lattice_uniform_2.Lattice_core)
geometry_11 = Geometry(populate_lattice_uniform_2.Lattice_boundary)
geometry_12 = Geometry(populate_lattice_uniform_2.Lattice_trimmed)
geometry_13 = Geometry(populate_lattice_uniform_2.Lattice_boundary_connect)
geometry_14 = Geometry(populate_lattice_uniform_2.Lattice_skin)
geometry_15 = Geometry(populate_lattice_uniform.Lattice_boundary)
geometry_16 = Geometry(populate_lattice_uniform.Lattice_boundary_connect)

# ----
# Voxels
cell_length_6 = X(cell_length)
x_count = XCount(6)
# Note: this script uses a simple
# form of voxelization.
# Other plugins offer more options.
expression = Expression(x=cell_length_6, y=x_count, Expression="x*y/2-x/2")
z_count = ZCount(10)
box_array = BoxArray(Geometry=center_box, Cell=center_box, XCount=x_count, YCount=x_count, ZCount=z_count)  # -> Geometry, Transform
construct_point = ConstructPoint(XCoordinate=expr("-x", expression), YCoordinate=expr("-x", expression), ZCoordinate=0)
move = Move(Geometry=box_array.Geometry, Motion=construct_point)  # -> Geometry, Transform

serialize_json_2 = SerializeJson(Data1=panel, IncludeNullAndEmptyProperties=False)
number_4 = Number(expr("2*x-2", z_count))
radius = Radius(5.5)
serialize_json_3 = SerializeJson(Input_shape="Cylinder", Radius=radius, Data3=number_4, IncludeNullAndEmptyProperties=False)
merge = Merge(Data1=serialize_json, Data2=serialize_json_3)
logging_combine_json = LoggingCombineJSON(Input_json=merge)
# Refreshes with changes
# to id_properties
logging_system_info = LoggingSystemInfo(Refresh=Button(), Project_dir=panel_3, Save_directory=panel_2, Id_properties=logging_combine_json)  # -> Part_id, Date_utc, Mesh_path, Log_path, Gh_file, Base_unit, Device, Rhino_build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
serialize_json_4 = SerializeJson(
    Gh_file=logging_system_info.Gh_file,
    Base_unit=logging_system_info.Base_unit,
    Device=logging_system_info.Device,
    Rhino_build=logging_system_info.Rhino_build,
    Rhino_date=logging_system_info.Rhino_date,
    Gh_build=logging_system_info.Gh_build,
    Gh_date=logging_system_info.Gh_date,
    Core_dependencies=logging_system_info.Core_dependencies,
    Addon_dependencies=logging_system_info.Addon_dependencies,
    IncludeNullAndEmptyProperties=False)
serialize_json_5 = SerializeJson(Computation=serialize_json_4, IncludeNullAndEmptyProperties=False)
serialize_json_6 = SerializeJson(Part_id=logging_system_info.Part_id, Date_utc=logging_system_info.Date_utc, IncludeNullAndEmptyProperties=False)
# Primitive
cylinder_2 = Cylinder(Base=PlaneXY(0, 0, 0), Radius=radius, Length=number_4)
cap_holes_2 = CapHoles(Brep=cylinder_2)
primitive_prepare_origin_2 = PrimitivePrepareOrigin(Primitive=cap_holes_2)  # -> Primitive, Cut_surfaces, Symmetry_surfaces, Octant, Quarter
primitive_prepare_origin_3 = PrimitivePrepareOrigin(Primitive=cylinder_2)  # -> Primitive, Cut_surfaces, Symmetry_surfaces, Octant, Quarter
brep_wireframe_2 = BrepWireframe(Brep=cylinder_2, Density=-1)
manual_write = Button()
gate_or = GateOr(A=save_2, B=manual_write)
populate_lattice_uniform_3 = PopulateLatticeUniform(
    Boundary_voxels=move.Geometry,
    Unit_cell=brep_wireframe,
    Connectivity=center_box,
    Primitive=primitive_prepare_origin_3.Primitive)  # -> Lattice_core, Lattice_boundary, Lattice_trimmed, Lattice_boundary_connect, Lattice_skin
populate_lattice_uniform_4 = PopulateLatticeUniform(
    Boundary_voxels=move.Geometry,
    Unit_cell=brep_wireframe,
    Connectivity=center_box,
    Primitive=primitive_prepare_origin_2.Primitive)  # -> Lattice_core, Lattice_boundary, Lattice_trimmed, Lattice_boundary_connect, Lattice_skin
# Lattice
geometry_17 = Geometry(populate_lattice_uniform_3.Lattice_skin)
geometry_18 = Geometry(populate_lattice_uniform_4.Lattice_trimmed)
merge_2 = Merge(Data1=geometry_17, Data2=geometry_18, Data3=brep_wireframe_2)
voxel_size = VoxelSize(0.035)
bandwidth = Bandwidth(1)
isovalue = Isovalue(0)
adaptivity = Adaptivity(0.9)
create_settings = CreateSettings(VoxelSize=voxel_size, Bandwidth=bandwidth, Isovalue=isovalue, Adaptivity=adaptivity)
mesh_meshing_points = MeshMeshingPoints(
    Run=run,
    Points=point,
    Radius=r_4,
    DendroSettings=create_settings,
    Surfaces=surfaces,
    Bake=bake,
    Save=save,
    File_name="file.stl",
    Delete=delete)  # -> Out_mesh, Original_report, Mod_report, Cut_report, Volume, Area
serialize_json_7 = SerializeJson(
    Voxel_size=voxel_size,
    Bandwidth=bandwidth,
    Isovalue=isovalue,
    Adaptivity=adaptivity,
    IncludeNullAndEmptyProperties=False)
r_6 = Number(r)
create_settings_2 = CreateSettings(VoxelSize=voxel_size, Bandwidth=bandwidth, Isovalue=isovalue, Adaptivity=adaptivity)
segment_lattice_2 = SegmentLattice(Curves=flatten(merge_2), Radius=r_6)
# You can use this component to convert
#  Dendro volumes -- lattice or otherwise
mesh_to_volume = MeshToVolume(Mesh=primitive_prepare_origin_2.Primitive, Settings=create_settings_2)
# Mesh
mesh_meshing_points_2 = MeshMeshingPoints(
    Run=run_2,
    Points=segment_lattice_2,
    Radius=r_6,
    DendroSettings=create_settings_2,
    Surfaces=primitive_prepare_origin_3.Cut_surfaces,
    Bake=bake_2,
    Save=save_2,
    File_name=logging_system_info.Mesh_path,
    Delete=delete_2)  # -> Out_mesh, Original_report, Mod_report, Cut_report, Volume, Area
serialize_json_8 = SerializeJson(
    Lattice_volume=mesh_meshing_points_2.Volume,
    Lattice_surface_area=mesh_meshing_points_2.Area,
    IncludeNullAndEmptyProperties=False)
serialize_json_9 = SerializeJson(
    Lattice_properties=serialize_json,
    Primitive_properties=serialize_json_3,
    Volume_settings=serialize_json_7,
    Derived_properties=serialize_json_8,
    IncludeNullAndEmptyProperties=False)
merge_3 = Merge(
    Data1=serialize_json_2,
    Data2=serialize_json_6,
    Data3=serialize_json_5,
    Data4=serialize_json_9,
    Data5=mesh_meshing_points_2.Original_report,
    Data6=mesh_meshing_points_2.Mod_report,
    Data7=mesh_meshing_points_2.Cut_report)  # -> flatten(Result)
logging_combine_json_2 = LoggingCombineJSON(Input_json=merge_3)
logging_write = LoggingWrite(File_path=logging_system_info.Log_path, Content=logging_combine_json_2, Write_file=gate_or)
mesh_meshing_volume = MeshMeshingVolume(Run=run_2, DendroVolume=mesh_to_volume, DendroSettings=create_settings_2, Bake=bake_2)  # -> Out_mesh, Original_report, Mod_report, Cut_report, Volume, Area
